# Dynamo graph parametererstellen.dyn (Dynamo 2.18.1.5096)
# author: DL
# Erstellt einen einzelnen Projektparameter

name2_des_parameters = StringInput("Kostenstelle2")  # graph input
gruppenname = StringInput("FaM")  # graph input
typ_des_parameters = SpecTypes("autodesk.spec:spec.string")  # graph input
gruppentyp_des_parameters = GroupTypes("autodesk.parameter.group:identityData")  # graph input
exemplar_oder_typ = BoolSelector(true)  # graph input
categories = Categories("OST_MechanicalEquipment")  # graph input
createProjectParameter = Parameter.CreateProjectParameter(parameterName=name2_des_parameters, groupName=gruppenname, specType=typ_des_parameters, groupType=gruppentyp_des_parameters, instance=exemplar_oder_typ, categoryList=categories)
byPointAndString = Analysis.Label.ByPointAndString()  # unwired: point, label
string = StringInput("Testtext")  # graph input
